# Dynamo graph 01_ShortestPath.dyn (Dynamo 1.2.1.3083)

# note: Select Desired DBs
select_model_elements = DSModelElementsSelection()  # 8 picked in the model
# note: Select Main Switchboard
select_model_element = DSModelElementSelection()  # 1 picked in the model

# group: Gathers DBs and Switchboard, cycles to connect each DB with switchboard and finds route
watch = Watch(select_model_elements)
count = Count(watch)
cycle = List.Cycle(list=select_model_element, amount=count)

# group: Select Specific Type of Cable Tray
categories = Categories("CableTray")
all_elements_of_category = ElementsOfCategory(categories)
code_block = CodeBlock(x=all_elements_of_category) { x.Name; }
code_block_2 = CodeBlock { "Submains Cable Tray"; }
eq = code_block == code_block_2
filterByBoolMask = List.FilterByBoolMask(list=all_elements_of_category, mask=eq)
watch_2 = Watch(filterByBoolMask.in)
categories_2 = Categories("CableTrayFitting")
all_elements_of_category_2 = ElementsOfCategory(categories_2)
# note: Choose CableTray Type
code_block_3 = CodeBlock(x=all_elements_of_category_2) { x.Name; }
# note: Choose CableTray Fitting Type
code_block_4 = CodeBlock { "Submains Cable Tray"; }
eq_2 = code_block_3 == code_block_4
filterByBoolMask_2 = List.FilterByBoolMask(list=all_elements_of_category_2, mask=eq_2)
watch_3 = Watch(filterByBoolMask_2.in)
create = List.Create(watch_2, watch_3)
code_block_5 = CodeBlock { "Cable Trays"; }
byName = Category.ByName(code_block_5)
all_elements_of_category_3 = ElementsOfCategory(byName)

shortestPath = Custom[DynaTools.ShortestPath](Start=watch, End=cycle, create)  # Find the shortest path between two elements
flatten = Flatten(shortestPath.ShortestPath)
id = Element.Id(flatten)

# group: Filter Cable References from DBs
code_block_6 = CodeBlock { "Comments"; }
getParameterValueByName = Element.GetParameterValueByName(element=watch, parameterName=code_block_6)
code_block_7 = CodeBlock { 1; }
chop = List.Chop(list=getParameterValueByName, lengths=code_block_7)
count_2 = Count(shortestPath.ShortestPath@@L2, lacing=Longest)
code_block_8 = CodeBlock { 1; }
chop_2 = List.Chop(list=count_2, lengths=code_block_8)
cycle_2 = List.Cycle(list=chop, amount=chop_2, lacing=Longest)
flatten_2 = Flatten(cycle_2)

# group: Filter and compare lists to create output values
sort = List.Sort(id)
byElementId = Archilab.Grimshaw.Selection.Select.ByElementId(sort)
flatten_3 = Flatten(byElementId)
code_block_9 = CodeBlock(ID=id, Cable=flatten_2) { {ID+" "+Cable}; }
sort_2 = List.Sort(code_block_9)
code_block_10 = CodeBlock { 9; }
code_block_11 = CodeBlock { 4; }
substring = String.Substring(str=sort_2, startIndex=code_block_10, length=code_block_11)
flatten_4 = Flatten(substring)
create_2 = List.Create(flatten_3, flatten_4)
transpose = List.Transpose(create_2)
firstItem = List.FirstItem(transpose, lacing=Longest)
groupByKey = List.GroupByKey(list=transpose, keys=firstItem)
watch_4 = Watch(groupByKey.groups)
flatten_5 = Flatten(watch_4@L3)
firstItem_2 = List.FirstItem(flatten_5, lacing=Longest)
code_block_12 = CodeBlock { "Identity_Reference_Sub Main_Circuit"; }
getEvenOdd = Custom[Springs.List.GetEvenOdd](list=flatten_5, lacing=Longest)  # Gets the even and odd indices from the list.
watch_5 = Watch(getEvenOdd.odd)
code_block_13 = CodeBlock { ","; }
join = String.Join(code_block_13)  # unwired: arg1
map = List.Map(list=watch_5, f_x=join)
setParameterByName = Element.SetParameterByName(element=firstItem_2, parameterName=code_block_12, value=map)
lastItem = List.LastItem(transpose, lacing=Longest)
sortByKey = List.SortByKey(list=transpose, keys=lastItem)
