# Dynamo custom node DynaTools.ShortestPath.dyf (Dynamo 1.2.1.3083)
# category: DynaTools.ElementTools
# Find the shortest path between two elements

Input = Input()
Start = Input(Start : Elements.Element)
End = Input(End : Elements.Element)
# note: Find closest elements
python_script = Python(IN[0]=Input, IN[1]=Start, IN[2]=End)
# ---------- python_script.python (62 lines) ----------
# Copyright Cesare Caoduro 2017
# Mail: cesare.caoduro@gmail.com
# Twitter: @CesareCaoduro

import clr
import math

clr.AddReference('ProtoGeometry')
from Autodesk.DesignScript.Geometry import *

clr.AddReference('DSCoreNodes')
from DSCore import *

def pow2(n):
	return	math.pow(n,2)

def distance(p1,p2):
	return math.fabs(math.sqrt(pow2(p2.X-p1.X)+pow2(p2.Y-p1.Y)+pow2(p2.Z-p1.Z)))

#The inputs to this node will be stored as a list in the IN variables.

elements = List.Flatten(IN[0],2)
start = IN[1]
startLoc = start.GetLocation()
end = IN[2]
endLoc = end.GetLocation()

points = []
pointElements = []

for e in elements:
	eLoc = e.GetLocation()
	#startEndPoint.append(eLoc)
	try:
		s1 = Curve.PointAtParameter(eLoc,0)
		points.append(s1)
		pointElements.append(e)
		s2 = Curve.PointAtParameter(eLoc,1)
		points.append(s2)
		pointElements.append(e)
	except:
		points.append(eLoc)
		pointElements.append(e)

d0S = 1000000000
d0E = 1000000000
minS, minE = [],[]
sEl, eEl = [],[]

for p,e in zip(points,pointElements):
	dS = distance(p,startLoc)
	dE = distance(p,endLoc)
	if (dS<d0S):
		minS = p
		sEl = e
		d0S = dS
	if (dE<d0E):
		minE = p
		eEl = e
		d0E = dE

OUT = sEl,eEl
# ----------------------------------------
code_block = CodeBlock(lst=python_script) { lst[0]; lst[1]; }
# note: Find connection between elements
python_script_2 = Python(IN[0]=Input)
# ---------- python_script_2.python (57 lines) ----------
# Copyright Cesare Caoduro 2017
# Mail: cesare.caoduro@gmail.com
# Twitter: @CesareCaoduro

import clr
import math

clr.AddReference("RevitServices")
import RevitServices
from RevitServices.Persistence import DocumentManager
from RevitServices.Transactions import TransactionManager
doc = DocumentManager.Instance.CurrentDBDocument

clr.AddReference("RevitAPI")
import Autodesk
from Autodesk.Revit.DB import *

clr.AddReference("RevitNodes")
import Revit
clr.ImportExtensions(Revit.Elements)
clr.ImportExtensions(Revit.GeometryConversion)

clr.AddReference('DSCoreNodes')
from DSCore import *

#The inputs to this node will be stored as a list in the IN variables.
if isinstance(IN[0], list):
	elements = UnwrapElement(IN[0])
	toggle = 0
else:
	toggle = 1
	elements = [UnwrapElement(IN[0])]
	
p = []
dir = []
rep = []
ref = []

elements = List.Flatten(elements,2)

for e in elements:
	refs = []

	try:
		connectors = e.MEPModel.ConnectorManager.Connectors
	except:
		connectors = e.ConnectorManager.Connectors
	for conn in connectors:
		for c in conn.AllRefs:
			refs.append(c.Owner)
	ref.append(refs)

#Assign your output to the OUT variable.
if toggle:
	OUT = refs
else:
	OUT = ref
# ----------------------------------------
# note: Build relations graph
python_script_3 = Python(IN[0]=Input, IN[1]=python_script_2)
# ---------- python_script_3.python (29 lines) ----------
import clr
import math

clr.AddReference('DSCoreNodes')
from DSCore import *

clr.AddReference('ProtoGeometry')
from Autodesk.DesignScript.Geometry import *
#The inputs to this node will be stored as a list in the IN variables.

clr.AddReference('DSCoreNodes')
from DSCore import *

elements = List.Flatten(IN[0],2)
connected = IN[1]
edges = []
k = 0

for e in elements:
	edge = []
	conn = connected[k]
	for c in conn:
		if (e!=c):
			edge.append({e,c})
	k+=1
	edges.append(edge)
		

OUT = List.Flatten(edges,1)
# ----------------------------------------
# note: dijsktra
python_script_4 = Python(IN[0]=code_block.out0, IN[1]=code_block.out1, IN[2]=python_script_3)
# ---------- python_script_4.python (89 lines) ----------
import clr
clr.AddReference('ProtoGeometry')
from Autodesk.DesignScript.Geometry import *

import sys
sys.path.append(r'C:\Program Files (x86)\IronPython 2.7\Lib')

# Import RevitAPI
clr.AddReference("RevitAPI")
import Autodesk
from Autodesk.Revit.DB import *

# Import ToDSType(bool) extension method
clr.AddReference("RevitNodes")
import Revit
clr.ImportExtensions(Revit.Elements)

from collections import defaultdict

class Graph():
    def __init__(self):
        """
        self.edges is a dict of all possible next nodes
        e.g. {'X': ['A', 'B', 'C', 'E'], ...}
        self.weights has all the weights between two nodes,
        with the two nodes as a tuple as the key
        e.g. {('X', 'A'): 7, ('X', 'B'): 2, ...}
        """
        self.edges = defaultdict(list)
        self.weights = {}
    
    def add_edge(self, from_node, to_node, weight):
        # Note: assumes edges are bi-directional
        self.edges[from_node].append(to_node)
        self.edges[to_node].append(from_node)
        self.weights[(from_node, to_node)] = weight
        self.weights[(to_node, from_node)] = weight

def dijsktra(graph, initial, end):
    # shortest paths is a dict of nodes
    # whose value is a tuple of (previous node, weight)
    shortest_paths = {initial: (None, 0)}
    current_node = initial
    visited = set()
    
    while current_node != end:
        visited.add(current_node)
        destinations = graph.edges[current_node]
        weight_to_current_node = shortest_paths[current_node][1]

        for next_node in destinations:
            weight = graph.weights[(current_node, next_node)] + weight_to_current_node
            if next_node not in shortest_paths:
                shortest_paths[next_node] = (current_node, weight)
            else:
                current_shortest_weight = shortest_paths[next_node][1]
                if current_shortest_weight > weight:
                    shortest_paths[next_node] = (current_node, weight)
        
        next_destinations = {node: shortest_paths[node] for node in shortest_paths if node not in visited}
        if not next_destinations:
            return "Route Not Possible"
        # next node is the destination with the lowest weight
        current_node = min(next_destinations, key=lambda k: next_destinations[k][1])
    
    # Work back through destinations in shortest path
    path = []
    while current_node is not None:
        path.append(current_node)
        next_node = shortest_paths[current_node][0]
        current_node = next_node
    # Reverse path
    path = path[::-1]
    return path



start = IN[0]
end = IN[1]
edges = IN[2]

graph = Graph()

for edge in edges:
	graph.add_edge(edge[0],edge[1],1)


#Assign your output to the OUT variable.
OUT = dijsktra(graph, start, end)
# ----------------------------------------
ShortestPath = Output(python_script_4)  # "ShortestPath: List"
getLocation = Element.GetLocation(python_script_4)
ShortestPathLocations = Output(getLocation)  # "ShortestPathLocations: List"
