# Dynamo graph Calculate Total Length of Selected Lines.dyn (Dynamo 2.1.0.7464)

# group: Calculate Total Length of Selected Lines
# note: CATEGORY:
# Modeling
# DESCRIPTION:
# This workflow allows you to select multiple detail or model lines and find out their total length. By toggling the Boolean input to True, current project units will be used. When set to False, Revit's internal units of Feet will be used to display total length.
# MODEL PREPARATION:
# - None
# NOTE:
#  - Results will round up to the nearest whole number.
# AUTHORS:
# - Autodesk
# REQUIRED PACKAGES:
# - None
# Copyright(c) 2017, Autodesk

# group: Select detail/model lines.
select_detail_and_model_lines = DSModelElementsSelection()  # nothing selected; graph input

# group: Make sure to filter out anything that is not of category Line.
getCategory = Element.GetCategory(element=select_detail_and_model_lines)
name = Category.Name(category=getCategory)
code_block = CodeBlock { "Lines"; }
eq = name == code_block
filterByBoolMask = List.FilterByBoolMask(list=select_detail_and_model_lines, mask=eq)

# group: Measure curve total length
string = StringInput("Length")
getParameterValueByName = Element.GetParameterValueByName(element=filterByBoolMask.in, parameterName=string)

# group: If set to False length will be calculated in FT. If True, current project units will be used.
set_true_for_current_project = BoolSelector(true)  # "Set True for current project units. Set False for units in feet."; graph input

# group: Calculate total length for selected curves. Convert between units depending on user input.
sum = Math.Sum(values=getParameterValueByName)
toFeet = Python(IN[0]=sum)  # "ConvertLength.ToFeet"
# ---------- toFeet.python (36 lines) ----------
# Import DocumentManager and TransactionManager
import clr
clr.AddReference("RevitServices")
import RevitServices
from RevitServices.Persistence import DocumentManager
doc = DocumentManager.Instance.CurrentDBDocument

# Import RevitAPI
clr.AddReference("RevitAPI")
import Autodesk
from Autodesk.Revit.DB import *

# Add reference to IronPython Lib folder
import sys
pyt_path = r'C:\Program Files (x86)\IronPython 2.7\Lib'
sys.path.append(pyt_path)

# Set up inputs
value = IN[0]

# Execute definition
try:
	errorReport = None
	
	duLength = doc.GetUnits().GetFormatOptions(UnitType.UT_Length).DisplayUnits
	displayUnit = LabelUtils.GetLabelFor(duLength)
except:
	# If error accurs anywhere in the process catch it
	import traceback
	errorReport = traceback.format_exc()

# Assign your output to the OUT variable
if errorReport == None:
	OUT = [UnitUtils.ConvertToInternalUnits(value, duLength), displayUnit, duLength.ToString()]
else:
	OUT = errorReport
# ----------------------------------------
# note: Dynamo adopts its display units to whatever Revit project Lenght units are set to. We can either convert to Feet or keep the project units.
code_block_2 = CodeBlock(IN=toFeet) { IN[0]; IN[1]; IN[2]; }

# group: Create curve report.
code_block_3 = CodeBlock { "Selected curves: "; "\n"; "Total Length: "; " "; }
count = List.Count(list=getParameterValueByName)
string_from_object = FromObject(obj=count)
if_ = If(test=set_true_for_current_project, true=sum, false=code_block_2.out0)
string_from_object_2 = FromObject(obj=if_)
code_block_4 = CodeBlock { "FEET"; }
if_2 = If(test=set_true_for_current_project, true=code_block_2.out1, false=code_block_4)
concat = String.Concat(string0=code_block_3.out0, string1=string_from_object, string2=code_block_3.out1, string3=code_block_3.out2, string4=string_from_object_2, string5=code_block_3.out3, string6=if_2)

# group: Output
calculation_results = Watch(concat)  # graph output
