# Dynamo graph AEC - Duplicate Sheets_orig.dyn (Dynamo 2.5.0.7460)
# packages: LunchBox for Dynamo 2018.8.8, Data-Shapes 2021.2.91, bimorphNodes 3.0.3

# group: START SCREEN
# note: SPECIFICATIONS:
# DESCRIPTION:
# When you run this script you need to select the sheets that need to be copied, and decide wether the view placed on the sheet will also be copied.
# FILES:
#   	REVIT 	Existing Sheets
#   	EXCEL 	Not Needed
# AUTHOR(S):
# 	Created: 		K. Pelzer
# 	Optimized:
# PACKAGE(S):
# 	Cadac Group
# 	Lunchbox
# 	Data Shapes
# 	BimorphNodes
# DYNAMO VERS.:
# 	1.3.0
# SCRIPT VERS.:
# 	1.0.0
# note: INPUT:
# ELEMENTS:
# DATA:
# 	Sheets available in project
# note: OUTPUT:
# ELEMENTS:
# DATA:
# 	Sheets and Views
# FILES:
# note: Credits: Cadac Group AEC
# note: EXTRA:
# CREDITS:
# Inspired and based on certain workflows/packages created by other people. Those packages are copied into the Cadac Group Library for stability and maintenanace purposes only. Credits still go to those people. A big thank you for sharing that knowlegde. We will always mention the original packages in the list below.
# PACKAGE(S):
# Data Shapes
# Lunchbox
# BimorphNodes

start = BoolSelector(true)  # graph input

# group: Input Options Create User Interface
file_path = Filename("..\..\..\..\..\..\..\..\Users\kpelzer\SharePoint\Niels Oomen\Dynamo\Logo\Logo Cadac Group 100x100.png")  # graph input; frozen
code_block = CodeBlock { "Select sheets to duplicate"; }
fromPath = FileObject()  # "File.FromPath"; unwired: path
readFromFile = Image.ReadFromFile(file=fromPath)
string = StringInput("Duplicate")  # graph input
lunchbox_sheet_collector = Custom[LunchBox Sheet Collector](Toggle=start)  # package LunchBox for Dynamo; Collects sheets from the current document
string_2 = StringInput("Sheetname Prefix")  # graph input
string_3 = StringInput("")  # graph input
string_4 = StringInput("Sheetname Suffix")  # graph input
string_5 = StringInput("Copy")  # graph input
string_6 = StringInput("Duplicate Views")  # graph input
boolean = BoolSelector(true)  # graph input
string_7 = StringInput("Duplicate Option Choose: 0 for Duplicate, 1 for Duplicate With Detailing or 2 for Duplicate As Dependent")  # graph input
string_8 = StringInput("1")  # graph input

ui_listview_data = Custom[UI.Listview Data](InputName=code_block, Keys=lunchbox_sheet_collector.Name, Values=lunchbox_sheet_collector.Element)  # package Data-Shapes; Create data for ListView input in UI.MultiInputForm ++ . Check out www.data-shapes.net for more infos.
ui_textbox_data = Custom[UI.TextBox Data](InputName=string_2, DefaultText=string_3)  # package Data-Shapes; Create Data for TextBox input in UI.MultipleInputForm ++ . Check out www.data-shapes.net for more informations
ui_textbox_data_2 = Custom[UI.TextBox Data](InputName=string_4, DefaultText=string_5)
ui_boolean_input = Custom[UI.Boolean input](InputName=string_6, DefaultValue=boolean)  # package Data-Shapes; Creates a boolean input for UI.MultipleInputForm ++ . Check out www.data-shapes.net for more infos!
ui_textbox_data_3 = Custom[UI.TextBox Data](InputName=string_7, DefaultText=string_8)

# group (continued): Input Options Create User Interface
create = List.Create(item0=ui_listview_data, item1=ui_textbox_data, item2=ui_textbox_data_2, item3=ui_boolean_input, item4=ui_textbox_data_3)
ui_multipleinputform = Custom[UI.MultipleInputForm ++](Description_optional=code_block, Logo_optional=readFromFile, ButtonText_optional=string, Inputs=create, Toggle=start)  # package Data-Shapes; Create a form with multiple inputs. see www.data-shapes.net for tutorials and infos!

# group: Translate Output
number = DoubleInput(0)  # graph input
getItemAtIndex = List.GetItemAtIndex(list=ui_multipleinputform.User_Inputs, index=number)
number_2 = DoubleInput(3)  # graph input
getItemAtIndex_2 = List.GetItemAtIndex(list=ui_multipleinputform.User_Inputs, index=number_2)
number_3 = DoubleInput(4)  # graph input
getItemAtIndex_3 = List.GetItemAtIndex(list=ui_multipleinputform.User_Inputs, index=number_3)
toNumber = String.ToNumber(str=getItemAtIndex_3)
number_4 = DoubleInput(2)  # graph input
getItemAtIndex_4 = List.GetItemAtIndex(list=ui_multipleinputform.User_Inputs, index=number_4)
number_5 = DoubleInput(1)  # graph input
getItemAtIndex_5 = List.GetItemAtIndex(list=ui_multipleinputform.User_Inputs, index=number_5)

duplicate = Revit.Sheet.Duplicate(sheets=getItemAtIndex, run=ui_multipleinputform.Was_Run, duplicateWithViews=getItemAtIndex_2, duplicateOption=toNumber, suffix=getItemAtIndex_4, prefix=getItemAtIndex_5)
