# Dynamo graph Duplicate Sheets with Views (P)_lab.dyn "Duplicate Sheets with Views (P)" (Dynamo 2.5.0.7460)
# packages: bimorphNodes 3.0.3, Data-Shapes 2019.2.42, Clockwork for Dynamo 2.x 2.1.2, spring nodes 202.1.0

# group: Collect and Select Sheets
code_block = CodeBlock { "Sheet Selection"; }
categories = Categories("OST_Sheets")
all_elements_of_category = ElementsOfCategory(Category=categories)
sheetNumber = Sheet.SheetNumber(sheet=all_elements_of_category)
sheetName = Sheet.SheetName(sheet=all_elements_of_category)
code_block_2 = CodeBlock(a=sheetNumber, b=sheetName) { a+" - "+b; }
boolean = BoolSelector(true)
# note: Custom Node: Data-Shapes v.2019.2.42
ui_listview_data = Custom[UI.Listview Data](InputName=code_block, Keys=code_block_2, Values=all_elements_of_category, ShowId_optionnal=boolean)  # package Data-Shapes; Create data for ListView input in UI.MultiInputForm ++ . Check out www.data-shapes.net for more infos.

# group: Duplicate Option
code_block_3 = CodeBlock { "Duplicate With Detailing"; }
boolean_2 = BoolSelector(true)
# note: Custom Node: Data-Shapes v.2019.2.42
ui_boolean_input = Custom[UI.Boolean input](InputName=code_block_3, DefaultValue=boolean_2)  # package Data-Shapes; Creates a boolean input for UI.MultipleInputForm ++ . Check out www.data-shapes.net for more infos!

# group: Add Prefix
code_block_4 = CodeBlock { "Prefix"; }
code_block_5 = CodeBlock { ""; }
# note: Custom Node: Data-Shapes v.2019.2.42
ui_textbox_data = Custom[UI.TextBox Data](InputName=code_block_4, DefaultText=code_block_5)  # package Data-Shapes; Create Data for TextBox input in UI.MultipleInputForm ++ . Check out www.data-shapes.net for more informations

# group: Add Suffix
code_block_6 = CodeBlock { "Suffix"; }
code_block_7 = CodeBlock { ""; }
# note: Custom Node: Data-Shapes v.2019.2.42
ui_textbox_data_2 = Custom[UI.TextBox Data](InputName=code_block_6, DefaultText=code_block_7)

# group: User Form
code_block_8 = CodeBlock { "Select Sheets To Duplicate"; }
code_block_9 = CodeBlock { "Duplicate Selected Sheets"; }
list_create = List.Create(item0=ui_listview_data, item1=ui_boolean_input, item2=ui_textbox_data, item3=ui_textbox_data_2)
boolean_3 = BoolSelector(true)
code_block_10 = CodeBlock { "Cancel"; }
code_block_11 = CodeBlock { 600; }
# note: Custom Node: Data-Shapes v.2019.2.42
ui_multipleinputform = Custom[UI.MultipleInputForm ++](Description_optional=code_block_8, ButtonText_optional=code_block_9, Inputs=list_create, Toggle=boolean_3, CancelButtonText_optional=code_block_10, Width_optional=code_block_11)  # package Data-Shapes; Create a form with multiple inputs. see www.data-shapes.net for tutorials and infos!

# group: Creates Sheets and Duplicates Views
code_block_12 = CodeBlock { 0; }
getItemAtIndex = List.GetItemAtIndex(list=ui_multipleinputform.User_Inputs, index=code_block_12)
boolean_4 = BoolSelector(true)
boolean_5 = BoolSelector(true)
code_block_13 = CodeBlock { 1; }
getItemAtIndex_2 = List.GetItemAtIndex(list=ui_multipleinputform.User_Inputs, index=code_block_13)
# note: Custom Node: Clockwork v.2.1.2
fromBooleans = Custom[Binary.FromBooleans](booleans=getItemAtIndex_2)  # package Clockwork for Dynamo 2.x; Creates a binary string from a list of booleans
string_from_object = FromObject(obj=fromBooleans)
toNumber = String.ToNumber(str=string_from_object)
code_block_14 = CodeBlock { 3; }
getItemAtIndex_3 = List.GetItemAtIndex(list=ui_multipleinputform.User_Inputs, index=code_block_14)
code_block_15 = CodeBlock { 2; }
getItemAtIndex_4 = List.GetItemAtIndex(list=ui_multipleinputform.User_Inputs, index=code_block_15)
# note: Custom Node: BimorphNodes v.3.0.3
# note: PLACE SHEET BY SELECTED DISCIPLINE
duplicate = Revit.Sheet.Duplicate(sheets=getItemAtIndex, run=boolean_4, duplicateWithViews=boolean_5, duplicateOption=toNumber, suffix=getItemAtIndex_3, prefix=getItemAtIndex_4)
watch = Watch(duplicate.Sheet)

# group: Image
file_path = Filename("..\..\..\..\OneDrive\Gemini BIM\Dynamo\Images\Gemini BIM Logo.png")  # frozen
file_from_path = FileObject(path=file_path)
readFromFile = Image.ReadFromFile(file=file_from_path)

# group: Import from Excel
categories_2 = Categories("OST_Sheets")  # frozen

# group: Map Link to Excel sheet list
categories_3 = Categories("OST_Sheets")  # frozen

# group: Append map then Duplicate Views
categories_4 = Categories("OST_Sheets")  # frozen

# group: 1
search_term_for_arch_link = StringInput("ARCH")  # graph input; frozen

# group: 2
view_name_contains = StringInput("S BLDG")  # graph input; frozen

# group: Copy from link
categories_5 = Categories("OST_Sheets")  # frozen
list_of_links = Watch()  # unwired: arg0
boolean_6 = BoolSelector(true)  # graph input
contains = String.Contains(str=list_of_links, searchFor=search_term_for_arch_link, ignoreCase=boolean_6)
filterByBoolMask = List.FilterByBoolMask(mask=contains)  # unwired: list
isNull = Object.IsNull()  # frozen; unwired: obj
filterByBoolMask_2 = List.FilterByBoolMask(mask=isNull)  # unwired: list
code_block_16 = CodeBlock { "View Name"; }  # frozen
getParameterValueByName = Element.GetParameterValueByName(element=filterByBoolMask_2.out, parameterName=code_block_16)
contains_2 = String.Contains(str=getParameterValueByName, searchFor=view_name_contains)
filterByBoolMask_3 = List.FilterByBoolMask(list=filterByBoolMask_2.out, mask=contains_2)
create = List.Create(item0=filterByBoolMask_3.in)
copyFromLinkInstance = Custom[Springs.Doc.CopyFromLinkInstance](LinkInstance=filterByBoolMask.in, element=create)  # package spring nodes; The node will use the total transformation of the link instance to copy the input elements into the local document.
watch_2 = Watch(copyFromLinkInstance)
getFromLinkedFile = Custom[Element.GetFromLinkedFile]()  # frozen
categories_6 = Categories("OST_Views")  # graph input; frozen
filterByBoolMask_4 = List.FilterByBoolMask()  # frozen; unwired: list, mask
get_documents = Custom[Get Documents]()  # frozen

import_from_linked_model = Python()  # frozen; unwired: IN[0]
# ---------- import_from_linked_model.python (17 lines) ----------
import clr 
clr.AddReference("RevitAPI")
from Autodesk.Revit.DB import*

clr.AddReference("RevitServices")
from RevitServices.Persistence import DocumentManager 

doc=DocumentManager.Instance.CurrentDBDocument

link_inst=FilteredElementCollector(doc).OfCategory(BuiltInCategory.OST_RvtLinks).WhereElementIsNotElementType()

linkDoc, linkName = [], []
for i in link_inst:
	linkDoc.append(i.GetLinkDocument())
	linkName.append(i.Name)

OUT=link_inst,linkDoc,linkName 
# ----------------------------------------
