# Dynamo graph SHARED PARAM_WIP_lab.dyn "SHARED PARAM_WIP" (Dynamo 2.3.0.5885)
# packages: archi-lab.net 2020.23.7, Orchid 230.0.2.7458

file_path = Filename("C:\Users\Marty\Desktop\DYN TOOLS\Bulk Add Shared Parameters\SHARED PARAMETERS_WIP.xlsx")
file_from_path = FileObject(path=file_path)
code_block = CodeBlock { "Sheet1"; }
importExcel = Data.ImportExcel(file=file_from_path, sheetName=code_block)
restOfItems = List.RestOfItems(list=importExcel)
transpose = List.Transpose(lists=restOfItems)
clear_list = Custom[Clear List](input=transpose)  # package archi-lab.net; This node will remove all Null and Empty Lists from any list.
code_block_2 = CodeBlock(ParamData=clear_list) { ParamData[0]; ParamData[1]; ParamData[2]; ParamData[3]; ParamData[4]; ParamData[5]; ParamData[6]; ParamData[7]; }
byName = Category.ByName(name=code_block_2.out7)
create = Orchid.RevitProject.Parameters.SharedParameter.Create(parameterName=code_block_2.out0, groupName=code_block_2.out1, type=code_block_2.out2, group=code_block_2.out3, tooltip=code_block_2.out4, instance=code_block_2.out5, vary=code_block_2.out6, category=byName, lacing=Longest)
