# Dynamo graph WSP_ASSIGN_SPACE_TYPES_V1.dyn (Dynamo 1.3.2.2480)

# group: User Selection
categories = Categories("MEPSpaces")
all_elements_of_category = ElementsOfCategory(categories)
watch = Watch(all_elements_of_category)
file_path = Filename("V:\BIM\Dynamo\Test Files\Assign Space Types\Space Types.xlsx")

# group: Discovery and Retrieval of Information
fromPath = FileObject(file_path)  # "File.FromPath"
string = StringInput("REVIT IMPORT")
readFromFile = Excel.ReadFromFile(file=fromPath, sheetName=string)

# group: Processing Data
transpose = List.Transpose(readFromFile)
number = DoubleInput(4)
getItemAtIndex = List.GetItemAtIndex(list=transpose, index=number)
watch_2 = Watch(getItemAtIndex)
transpose_2 = List.Transpose(readFromFile)

# group: Writing Data
code_block = CodeBlock { "Space Type"; }
setParameterByName = Element.SetParameterByName(element=watch, parameterName=code_block, value=watch_2)

watch_3 = Watch(readFromFile)
