# Dynamo graph Equipment Circuiting - Testing.dyn (Dynamo 2.0.3.8810)

categories = Categories(index=189)
all_elements_of_category = ElementsOfCategory(Category=categories)

# group: The parameter where we read the equipment name
string = StringInput("Comments")

parameterByName = Parameter.ParameterByName(element=all_elements_of_category, name=string)
value = Parameter.Value(parameter=parameterByName)
watch = Watch(value)
isNull = Object.IsNull(obj=watch)
filterByBoolMask = List.FilterByBoolMask(list=watch, mask=isNull)
watch_2 = Watch(filterByBoolMask.out)

# group: Enter Tab Name below, add and subtract tabs as need.
enter_the_tab_name = StringInput("2a")  # graph input
enter_the_tab_name_2 = StringInput("2b")  # graph input
enter_the_tab_name_3 = StringInput("0b")  # graph input
enter_the_tab_name_4 = StringInput("3b")  # graph input
enter_the_tab_name_5 = StringInput("3a")  # graph input
enter_the_tab_name_6 = StringInput("4a")  # graph input
enter_the_tab_name_7 = StringInput("4b")  # graph input
enter_the_tab_name_8 = StringInput("5a")  # graph input
enter_the_tab_name_9 = StringInput("5b")  # graph input
enter_the_tab_name_10 = StringInput("BSL3")  # graph input
enter_the_tab_name_11 = StringInput("Equipment Info")  # graph input
create = List.Create(item0=enter_the_tab_name_11)

# group: Select excel file and tab of which to read the information
enter_the_tab_name_12 = StringInput("2a")  # graph input
file_path = Filename("Mech Testing\Equipment Circuiting\Equipment Info.xlsx")  # graph input
fromPath = FileObject(path=file_path)  # "File.FromPath"
importExcel = Data.ImportExcel(file=fromPath, sheetName=create)
boolean = BoolSelector(true)
clean = List.Clean(list=importExcel, preserveIndices=boolean)

number = DoubleInput(1)  # graph input
flatten = List.Flatten(list=clean, amt=number)
watch_3 = Watch(flatten)
restOfItems = List.RestOfItems(list=watch_3)
string_2 = StringInput("NOT USED")
create_2 = List.Create(item0=string_2, item1=string_2, item2=string_2, item3=string_2, item4=string_2, item5=string_2, item6=string_2, item7=string_2, item8=string_2, item9=string_2, item10=string_2, item11=string_2, item12=string_2, item14=string_2, item15=string_2)  # unwired: item13
replace_nulls_with_blanks = Python(IN[0]=restOfItems, IN[1]=create_2)
# ---------- replace_nulls_with_blanks.python (12 lines) ----------
import clr
clr.AddReference('ProtoGeometry')
from Autodesk.DesignScript.Geometry import *
#The inputs to this node will be stored as a list in the IN variables.
items = IN[0]
rep = IN[1]
elementlist = list()
for item in items:
	if item is None: 
		item = rep
	elementlist.append(item)
OUT = elementlist
# ----------------------------------------

# group: The list of aviable cells from the tab in the excel file.
watch_4 = Watch(replace_nulls_with_blanks)

number_2 = DoubleInput(1)
getItemAtIndex = List.GetItemAtIndex(list=watch_4@L2, index=number_2)
# note: Custom Node: RIE v.0.6.5
getPanelScheduleViews = Custom[RIE.GetPanelScheduleViews]()  # Gets Panel Schedules Views
panel_schedule_designation = StringInput("Panel Schedule Name")  # "Panel Schedule Designation Parameter Name"; graph input
parameterByName_2 = Parameter.ParameterByName(element=getPanelScheduleViews, name=panel_schedule_designation)
value_2 = Parameter.Value(parameter=parameterByName_2)
watch_5 = Watch(value_2)
isNull_2 = Object.IsNull(obj=watch_5)
filterByBoolMask_2 = List.FilterByBoolMask(list=watch_5, mask=isNull_2)
python_script = Python(IN[0]=filterByBoolMask_2.out, IN[1]=watch_4)
# ---------- python_script.python (28 lines) ----------
import clr
clr.AddReference('ProtoGeometry')
from Autodesk.DesignScript.Geometry import *
#The inputs to this node will be stored as a list in the IN variables.
EQUIPMENT = IN[0]
EQUIPMENTLIST = IN[1]
index = 0
l1 = 0
l2 = 0
outlist= []

l1max = len(EQUIPMENTLIST)

while l1<l1max:
	l2max = len(EQUIPMENT)
	while l2< l2max:
		if EQUIPMENT[l2] == EQUIPMENTLIST[l1][0]:
			index = l1
			x = [index,l2]
			outlist.append(x)
		l2 = l2+1
	l2 = 0	
	l1 = l1 + 1



#Assign your output to the OUT variable.
OUT = outlist
# ----------------------------------------
index_of_vav = Watch(python_script)
number_3 = DoubleInput(1)
getItemAtIndex_2 = List.GetItemAtIndex(list=index_of_vav@L2, index=number_3)
getItemAtIndex_3 = List.GetItemAtIndex(list=getPanelScheduleViews, index=getItemAtIndex_2)
# note: Custom Node: MEPover v.2019.9.3
electricalCircuits = Custom[PanelScheduleView.ElectricalCircuits](PanelScheduleView=getItemAtIndex_3)  # Returns the circuits that are listed in the panelschedule, this includes spare circuits.
count = List.Count(list=electricalCircuits@L2)
numberOfSlots = Custom[PanelScheduleView.NumberOfSlots](PanelScheduleView=getItemAtIndex_3)  # Returns the number of available slots in a panelschedule
le = count <= numberOfSlots
parameterByName_3 = Parameter.ParameterByName(element=all_elements_of_category, name=string)
value_3 = Parameter.Value(parameter=parameterByName_3)
watch_6 = Watch(value_3)
isNull_3 = Object.IsNull(obj=watch_6)
filterByBoolMask_3 = List.FilterByBoolMask(list=all_elements_of_category, mask=isNull_3)
getParameterValueByName = Element.GetParameterValueByName(element=filterByBoolMask_3.out, parameterName=string)
python_script_2 = Python(IN[0]=getParameterValueByName, IN[1]=watch_4)
# ---------- python_script_2.python (28 lines) ----------
import clr
clr.AddReference('ProtoGeometry')
from Autodesk.DesignScript.Geometry import *
#The inputs to this node will be stored as a list in the IN variables.
EQUIPMENT = IN[0]
EQUIPMENTLIST = IN[1]
index = 0
l1 = 0
l2 = 0
outlist= []

l1max = len(EQUIPMENTLIST)

while l1<l1max:
	l2max = len(EQUIPMENT)
	while l2< l2max:
		if EQUIPMENT[l2] == EQUIPMENTLIST[l1][1]:
			index = l1
			x = [index,l2]
			outlist.append(x)
		l2 = l2+1
	l2 = 0	
	l1 = l1 + 1



#Assign your output to the OUT variable.
OUT = outlist
# ----------------------------------------
index_of_vav_2 = Watch(python_script_2)
transpose = List.Transpose(lists=index_of_vav_2)
number_4 = DoubleInput(1)
getItemAtIndex_4 = List.GetItemAtIndex(list=transpose, index=number_4)
watch_7 = Watch(getItemAtIndex_4)
getItemAtIndex_5 = List.GetItemAtIndex(list=filterByBoolMask_3.out, index=watch_7)
watch_8 = Watch(getItemAtIndex_5)
electricalCircuit = Custom[Element.ElectricalCircuit](Element=watch_8)  # Returns the electrical circuit of the element
getPanelAndEquipmentFromCircuit = Custom[RIE.GetPanelAndEquipmentFromCircuit](Circuits=electricalCircuit)  # Gets panel circuit is connected to, and Elements connected to the circuit.
getElementConnector = Custom[RIE.GetElementConnector](Elements=watch_8)
mep_connector_info = Custom[MEP Connector info+](Element=watch_8)  # This node will return the connectors and a lot of information about those connectors of the input elements
watch_9 = Watch(mep_connector_info.ConnectedElements)
watch_10 = Watch(mep_connector_info.Description)
getPanelFromPanelScheduleView = Custom[RIE.GetPanelFromPanelScheduleView](PanelScheduleView=getItemAtIndex_3)  # Gets The panel corresponding to the input PanelScheduleView
watch_11 = Watch(electricalCircuit)
isNull_4 = Object.IsNull(obj=watch_11)
filterByBoolMask_4 = List.FilterByBoolMask(list=watch_8, mask=isNull_4)
powerElements = Custom[RIE.PowerElements](Elems=filterByBoolMask_4.in@L1)  # Powers list of elements
number_5 = DoubleInput(1)
flatten_2 = List.Flatten(list=powerElements, amt=number_5)
addToPanel = Custom[ElectricalSystem.AddToPanel](panel=getPanelFromPanelScheduleView, Circuits=flatten_2)  # Adds the circuits to the panel
watch_12 = Watch(addToPanel.Success)

# group: Parameter name where the load name will be written.
string_3 = StringInput("Load Name")

number_6 = DoubleInput(0)
getItemAtIndex_6 = List.GetItemAtIndex(list=transpose, index=number_6)
watch_13 = Watch(getItemAtIndex_6)
number_7 = DoubleInput(1)
python_script_3 = Python(IN[0]=watch_13, IN[1]=watch_4, IN[2]=number_7)
# ---------- python_script_3.python (23 lines) ----------
import clr
clr.AddReference('ProtoGeometry')
from Autodesk.DesignScript.Geometry import *
#The inputs to this node will be stored as a list in the IN variables.
VAVNUMBER = IN[0]
VAVLIST = IN[1]
COLUMNINDEX =IN[2]
index = 0
l1 = 0
l2 = 0
outlist= []

l1max = len(VAVNUMBER)

while l1<l1max:
	x=VAVLIST[VAVNUMBER[l1]][COLUMNINDEX]
	outlist.append(x)
	l1 = l1 + 1



#Assign your output to the OUT variable.
OUT = outlist
# ----------------------------------------
watch_14 = Watch(python_script_3)
isNull_5 = Object.IsNull(obj=watch_14)
string_4 = StringInput("")
if_ = If(test=isNull_5, true=string_4, false=watch_14)
equipment_name = Watch(if_)
number_8 = DoubleInput(4)
python_script_4 = Python(IN[0]=watch_13, IN[1]=watch_4, IN[2]=number_8)  # same code as python_script_3
watch_15 = Watch(python_script_4)
isNull_6 = Object.IsNull(obj=watch_15)
string_5 = StringInput("")
if_2 = If(test=isNull_6, true=string_5, false=watch_15)
HP = Watch(if_2)
python_script_5 = Python(IN[0]=equipment_name, IN[1]=HP)
# ---------- python_script_5.python (22 lines) ----------
import clr
clr.AddReference('ProtoGeometry')
from Autodesk.DesignScript.Geometry import *
#The inputs to this node will be stored as a list in the IN variables.
LIST1 = IN[0]
LIST2 = IN[1]
index = 0
l1 = 0
l2 = 0
outlist= []

l1max = len(LIST1)

while l1<l1max:
	x=LIST1[l1]+" "+LIST2[l1]
	outlist.append(x)
	l1 = l1 + 1



#Assign your output to the OUT variable.
OUT = outlist
# ----------------------------------------
watch_16 = Watch(python_script_5)
setParameterByName = Element.SetParameterByName(element=watch_12, parameterName=string_3, value=watch_16)

# group: Parameter name where the circuit breaker rating will be written.
string_6 = StringInput("Rating")

number_9 = DoubleInput(8)
python_script_6 = Python(IN[0]=watch_13, IN[1]=watch_4, IN[2]=number_9)  # same code as python_script_3
watch_17 = Watch(python_script_6)
isNull_7 = Object.IsNull(obj=watch_17)
string_7 = StringInput("")
if_3 = If(test=isNull_7, true=string_7, false=watch_17)
breaker_rating = Watch(if_3)
setParameterByName_2 = Element.SetParameterByName(element=watch_12, parameterName=string_6, value=breaker_rating)
filterByBoolMask_5 = List.FilterByBoolMask(list=watch_16, mask=isNull_4)
if_4 = If(test=isNull_4, true=flatten_2, false=filterByBoolMask_4.out)  # frozen
filterByBoolMask_6 = List.FilterByBoolMask(list=if_4, mask=isNull_4)
watch_18 = Watch(if_4)
getParameterValueByName_2 = Element.GetParameterValueByName(element=if_4, parameterName=string_3)

# group: Parameter name where the panel name will be written.
string_8 = StringInput("ROOM NUMBER")

number_10 = DoubleInput(0)
python_script_7 = Python(IN[0]=watch_13, IN[1]=watch_4, IN[2]=number_10)  # same code as python_script_3
watch_19 = Watch(python_script_7)
isNull_8 = Object.IsNull(obj=watch_19)
string_9 = StringInput("")
if_5 = If(test=isNull_8, true=string_9, false=watch_19)
room_name = Watch(if_5)
setParameterByName_3 = Element.SetParameterByName(element=watch_8, parameterName=string_8, value=room_name)  # frozen

# group: Parameter name where the horsepower will be written.
string_10 = StringInput("Misc. Tag")

number_11 = DoubleInput(4)
python_script_8 = Python(IN[0]=watch_13, IN[1]=watch_4, IN[2]=number_11)  # same code as python_script_3
watch_20 = Watch(python_script_8)
isNull_9 = Object.IsNull(obj=watch_20)
string_11 = StringInput("")
if_6 = If(test=isNull_9, true=string_11, false=watch_20)
watch_21 = Watch(if_6)
setParameterByName_4 = Element.SetParameterByName(element=watch_8, parameterName=string_10, value=watch_21)

# group: Parameter name where the VA will be written.
string_12 = StringInput("Apparent Load")

number_12 = DoubleInput(7)
python_script_9 = Python(IN[0]=watch_13, IN[1]=watch_4, IN[2]=number_12)  # same code as python_script_3
watch_22 = Watch(python_script_9)
isNull_10 = Object.IsNull(obj=watch_22)
string_13 = StringInput("")
if_7 = If(test=isNull_10, true=string_13, false=watch_22)
watch_23 = Watch(if_7)
setParameterByName_5 = Element.SetParameterByName(element=watch_8, parameterName=string_12, value=watch_23)  # frozen

# group: The parameter where we read the equipment name
string_14 = StringInput("Comments")

getParameterValueByName_3 = Element.GetParameterValueByName(element=filterByBoolMask_3.out, parameterName=string_14)
