# Dynamo graph WSP Revit to SKM Export Builder.dyn (Dynamo 2.0.2.6826)

# group: User Input
file_path = Filename("..\..\..\..\Desktop\B1912554 Texoma Exp (2020-02-05e)\RevitOutput-2020-02-05e")
delimiter_tab = StringInput("	")  # graph input
bus_prefix = StringInput("B-")  # graph input
feeder_prefix = StringInput("C-")  # graph input
cb_prefix = StringInput("CB-")  # graph input
al_name_code_block = CodeBlock { "Aluminium"; }
xfmr_prefix = StringInput("X-")  # graph input
feet_or_mm = StringInput("")  # graph input

categories = Categories(index=185)  # graph input
all_elements_of_category = ElementsOfCategory(Category=categories)

# group: Elec Equip "Part Types"
getFamily = FamilyInstance.GetFamily(familyInstance=all_elements_of_category)
string = StringInput("Part Type")  # graph input
parameterByName = Parameter.ParameterByName(element=getFamily, name=string)
string_from_object = FromObject(obj=parameterByName)

# group: All Switchboards
string_2 = StringInput("Part Type : Switchboard")  # graph input
reduces_list_to_a_list_of_only = Python(IN[0]=string_from_object, IN[1]=string_2)  # "Reduces list to a list of only IN[1]"
# ---------- reduces_list_to_a_list_of_only.python (16 lines) ----------
import clr
clr.AddReference('ProtoGeometry')
from Autodesk.DesignScript.Geometry import *
#The inputs to this node will be stored as a list in the IN variables.
PartTypes = IN[0]
Type1 = IN[1]
list1 = []
n = 0

while n < len(PartTypes):
	if (PartTypes[n] == Type1):
		list1.append(n) #making a list of index numbers
	n = n + 1
		
#Assign your output to the OUT variable.
OUT = list1
# ----------------------------------------
getItemAtIndex = List.GetItemAtIndex(list=all_elements_of_category, index=reduces_list_to_a_list_of_only)

# group: All Panelboards
string_3 = StringInput("Part Type : Panelboard")  # graph input
reduces_list_to_a_list_of_only_2 = Python(IN[0]=string_from_object, IN[1]=string_3)  # "Reduces list to a list of only IN[1]"; same code as reduces_list_to_a_list_of_only
getItemAtIndex_2 = List.GetItemAtIndex(list=all_elements_of_category, index=reduces_list_to_a_list_of_only_2)

join = List.Join(list0=getItemAtIndex, list1=getItemAtIndex_2)

# group: All Transformers
string_4 = StringInput("Part Type : Transformer")  # graph input
reduces_list_to_a_list_of_only_3 = Python(IN[0]=string_from_object, IN[1]=string_4)  # "Reduces list to a list of only IN[1]"; same code as reduces_list_to_a_list_of_only
getItemAtIndex_3 = List.GetItemAtIndex(list=all_elements_of_category, index=reduces_list_to_a_list_of_only_3)

# group: Transformers (Component Type 30)
categories_2 = Categories(index=184)  # graph input
all_elements_of_category_2 = ElementsOfCategory(Category=categories_2)
string_5 = StringInput("Load Name")
getParameterValueByName = Element.GetParameterValueByName(element=all_elements_of_category_2, parameterName=string_5)
transformers_elec_equip_does_not = Watch(getItemAtIndex_3)  # "Transformers (Elec Equip) (Does not match order of xfmr circuits"
xfmr_circuits_primary_side = Python(IN[0]=getParameterValueByName, IN[1]=transformers_elec_equip_does_not)
# ---------- xfmr_circuits_primary_side.python (22 lines) ----------
import clr
clr.AddReference('ProtoGeometry')
from Autodesk.DesignScript.Geometry import *

#The inputs to this node will be stored as a list in the IN variables.
ElecCircs = IN[0]
ElecEquip = IN[1]
list1 = []
n1 = 0
n2 = 0

while n1 < len(ElecCircs):
	while n2 < len(ElecEquip):
		if (ElecCircs[n1] == str(ElecEquip[n2])):
			list1.append(n1)
			n2 = len(ElecEquip)
		n2 = n2 + 1
	n2 = 0
	n1 = n1 + 1

#Assign your output to the OUT variable.
OUT = list1
# ----------------------------------------
list_getitematindex_all_xfmr_pri = List.GetItemAtIndex(list=all_elements_of_category_2, index=xfmr_circuits_primary_side)  # "List.GetItemAtIndex (All XFMR Pri Circuits)"
string_6 = StringInput("Panel")  # graph input
getParameterValueByName_2 = Element.GetParameterValueByName(element=all_elements_of_category_2, parameterName=string_6)
xfmr_circuits_secondary_side = Python(IN[0]=getParameterValueByName_2, IN[1]=transformers_elec_equip_does_not)  # same code as xfmr_circuits_primary_side
list_getitematindex_xfmr_sec = List.GetItemAtIndex(list=all_elements_of_category_2, index=xfmr_circuits_secondary_side)  # "List.GetItemAtIndex (XFMR Sec Circuits)"
string_7 = StringInput("""
// --- 2-Winding Transformer ---
//<ComponentName>	<ComponentType>	<AlternateName>	<Alternate ID>	<Alternate Description1>	<Alternate Description2>	<Alternate Cubicle Name>	<ConnectedComponent1>	<ConnectedComponent2>	<SystemNominalVoltage>	<SystemNominalVoltageSecondary>	<InService>	<Phase>	<Nominal kVA>	<FullLoad kVA>	<Size/Do Not Size>	<SizingCriteria>	<Pri Connection>	<Pri Tap>	<Pri RatedVoltage>	<Sec Connection>	<Sec Tap>	<Sec RatedVoltage>	<Manufacturer>	<Type>	<Rpos>	<Rzero>	<Xpos>	<Xzero>	<Pri NeutralR>	<Pri NeutralX>	<Sec NeutralR>	<Sec NeutralX>	<Ampacity>	<KeyInLibrary>""")  # graph input
string_8 = StringInput("Panel")
getParameterValueByName_3 = Element.GetParameterValueByName(element=list_getitematindex_xfmr_sec, parameterName=string_8)
xfmr_prefix_2 = Watch(xfmr_prefix)
pre_fix_it = Python(IN[0]=getParameterValueByName_3, IN[1]=xfmr_prefix_2)
# ---------- pre_fix_it.python (16 lines) ----------
import clr
clr.AddReference('ProtoGeometry')
from Autodesk.DesignScript.Geometry import *
#The inputs to this node will be stored as a list in the IN variables.
component = IN[0]
prefix = IN[1]
lcv = 0
list1 = []

while lcv < len(component):
	list1.append(prefix + component[lcv])
	lcv = lcv + 1


#Assign your output to the OUT variable.
OUT = list1
# ----------------------------------------
component_name = Watch(pre_fix_it)
component_type = StringInput("30")  # graph input
bus_prefix_2 = Watch(bus_prefix)
pre_fix_it_2 = Python(IN[0]=getParameterValueByName_3, IN[1]=bus_prefix_2)  # same code as pre_fix_it
feeder_post_fix = StringInput("-pri:1")
post_fix_it = Python(IN[0]=pre_fix_it_2, IN[1]=feeder_post_fix)
# ---------- post_fix_it.python (16 lines) ----------
import clr
clr.AddReference('ProtoGeometry')
from Autodesk.DesignScript.Geometry import *
#The inputs to this node will be stored as a list in the IN variables.
component = IN[0]
postfix = IN[1]
lcv = 0
list1 = []

while lcv < len(component):
	list1.append(component[lcv] + postfix)
	lcv = lcv + 1


#Assign your output to the OUT variable.
OUT = list1
# ----------------------------------------
upstream_component_1 = Watch(post_fix_it)
pre_fix_it_3 = Python(IN[0]=getParameterValueByName_3, IN[1]=bus_prefix_2)  # same code as pre_fix_it
feeder_post_fix_2 = StringInput("-sec:1")
post_fix_it_2 = Python(IN[0]=pre_fix_it_3, IN[1]=feeder_post_fix_2)  # same code as post_fix_it
downstream_component_2 = Watch(post_fix_it_2)
indexes_of_transformers_elec_eq = Python(IN[0]=getParameterValueByName_2, IN[1]=transformers_elec_equip_does_not)
# ---------- indexes_of_transformers_elec_eq.python (22 lines) ----------
import clr
clr.AddReference('ProtoGeometry')
from Autodesk.DesignScript.Geometry import *

#The inputs to this node will be stored as a list in the IN variables.
ElecCircs = IN[0]
ElecEquip = IN[1]
list1 = []
n1 = 0
n2 = 0

while n1 < len(ElecCircs):
	while n2 < len(ElecEquip):
		if (ElecCircs[n1] == str(ElecEquip[n2])):
			list1.append(n2)
			n2 = len(ElecEquip)
		n2 = n2 + 1
	n2 = 0
	n1 = n1 + 1

#Assign your output to the OUT variable.
OUT = list1
# ----------------------------------------
list_getitematindex_now_they = List.GetItemAtIndex(list=transformers_elec_equip_does_not, index=indexes_of_transformers_elec_eq)  # "List.GetItemAtIndex (Now they match!)"
string_9 = StringInput("Type")  # graph input
getParameterValueByName_4 = Element.GetParameterValueByName(element=list_getitematindex_now_they, parameterName=string_9)
name = FamilyType.Name(familyType=getParameterValueByName_4)
string_10 = StringInput("6")  # graph input
string_11 = StringInput("9")  # graph input
string_12 = StringInput("15")  # graph input
string_13 = StringInput("30")  # graph input
string_14 = StringInput("45")  # graph input
string_15 = StringInput("75")  # graph input
string_16 = StringInput("112.5")  # graph input
string_17 = StringInput("150")  # graph input
string_18 = StringInput("225")  # graph input
string_19 = StringInput("300")  # graph input
string_20 = StringInput("500")  # graph input
string_21 = StringInput("750")  # graph input
string_22 = StringInput("1000")  # graph input
create = List.Create(item0=string_10, item1=string_11, item2=string_12, item3=string_13, item4=string_14, item5=string_15, item6=string_16, item7=string_17, item8=string_18, item9=string_19, item10=string_20, item11=string_21, item12=string_22)
string_23 = StringInput("KVA")  # graph input
find_xfmr_kva_script = Python(IN[0]=create, IN[1]=string_23)
# ---------- find_xfmr_kva_script.python (21 lines) ----------
import clr
clr.AddReference('ProtoGeometry')
from Autodesk.DesignScript.Geometry import *
#The inputs to this node will be stored as a list in the IN variables.
wirelist = IN[0]
xfmrkva = IN[1]
x = []
list1 = []
max = len(wirelist)
number1 = 0
n = 0
wiremax = 0


while n < max:
	x = wirelist[n]+xfmrkva
	list1.append(x)			
	n = n + 1
		
#Assign your output to the OUT variable.
OUT = list1
# ----------------------------------------
find_xfmr_kva_script_2 = Python(IN[0]=name, IN[1]=find_xfmr_kva_script)
# ---------- find_xfmr_kva_script_2.python (61 lines) ----------
import clr
clr.AddReference('ProtoGeometry')
from Autodesk.DesignScript.Geometry import *
#The inputs to this node will be stored as a list in the IN variables.
wirelist = IN[0]
xfmrkva = IN[1]
x = []
list1 = []
max = len(wirelist)
number1 = 0
n = 0
wiremax = 0


while n < max:
	if xfmrkva[0] in wirelist[n]:
			x = "6"
			list1.append(x)
	elif xfmrkva[1] in wirelist[n]:
			x = "9"
			list1.append(x)
	elif xfmrkva[2] in wirelist[n]:
			x = "15"
			list1.append(x)
	elif xfmrkva[3] in wirelist[n]:
			x = "30"
			list1.append(x)
	elif xfmrkva[4] in wirelist[n]:
			x = "45"
			list1.append(x)
	elif xfmrkva[5] in wirelist[n]:
			x = "75"
			list1.append(x)
	elif xfmrkva[6] in wirelist[n]:
			x = "112.5"
			list1.append(x)
	elif xfmrkva[7] in wirelist[n]:
			x = "150"
			list1.append(x)
	elif xfmrkva[8] in wirelist[n]:
			x = "225"
			list1.append(x)
	elif xfmrkva[9] in wirelist[n]:
			x = "300"
			list1.append(x)
	elif xfmrkva[10] in wirelist[n]:
			x = "500"
			list1.append(x)
	elif xfmrkva[11] in wirelist[n]:
			x = "750"
			list1.append(x)
	elif xfmrkva[12] in wirelist[n]:
			x = "1000"
			list1.append(x)
	else:
			x = "1000"
			list1.append(x)			
	n = n + 1
		
#Assign your output to the OUT variable.
OUT = list1
# ----------------------------------------
nominal_kva = Watch(find_xfmr_kva_script_2)
string_24 = StringInput("Distribution System")
getParameterValueByName_5 = Element.GetParameterValueByName(element=list_getitematindex_now_they, parameterName=string_24)
string_25 = StringInput("Line to Line Voltage")
getParameterValueByName_6 = Element.GetParameterValueByName(element=getParameterValueByName_5, parameterName=string_25)
string_26 = StringInput("Actual Voltage")
getParameterValueByName_7 = Element.GetParameterValueByName(element=getParameterValueByName_6, parameterName=string_26)
string_27 = StringInput("Secondary Distribution System")  # graph input
getParameterValueByName_8 = Element.GetParameterValueByName(element=list_getitematindex_now_they, parameterName=string_27)
string_28 = StringInput("Line to Line Voltage")
getParameterValueByName_9 = Element.GetParameterValueByName(element=getParameterValueByName_8, parameterName=string_28)
string_29 = StringInput("Actual Voltage")
getParameterValueByName_10 = Element.GetParameterValueByName(element=getParameterValueByName_9, parameterName=string_29)
type = StringInput("Dry Type")  # graph input
key_in_library = StringInput("1")  # graph input
python_script_convert_volts = Python(IN[0]=getParameterValueByName_10)
# ---------- python_script_convert_volts.python (17 lines) ----------
import clr
clr.AddReference('RevitAPI')
from Autodesk.Revit.DB import *

#Becuase Revit's internal units for volts are not based on SI units (meters) they are based on feet, this converstion is needed.
#you could also mult Revit's volts by (0.3048^2), but it is extra block, and the number block keeps rounding from 0.3048 to 0.305...


rvtVolts = IN[0]
outVolts = []
lcv = 0

while lcv < len(rvtVolts):
	outVolts.append(str(UnitUtils.ConvertFromInternalUnits(rvtVolts[lcv],DisplayUnitType.DUT_VOLTS)))
	lcv = lcv + 1

OUT = outVolts
# ----------------------------------------
python_script_convert_volts_2 = Python(IN[0]=getParameterValueByName_7)  # same code as python_script_convert_volts

# group: All Distribution Circuits (no xfmr primary or secondary side of circuit)
categories_3 = Categories(index=184)  # graph input
all_elements_of_category_3 = ElementsOfCategory(Category=categories_3)
string_30 = StringInput("Panel")  # graph input
getParameterValueByName_11 = Element.GetParameterValueByName(element=all_elements_of_category_3, parameterName=string_30)
string_31 = StringInput("Load Name")  # graph input
getParameterValueByName_12 = Element.GetParameterValueByName(element=all_elements_of_category_3, parameterName=string_31)
compare_all_circs_w_dist_boards = Python(IN[0]=getParameterValueByName_11, IN[1]=getParameterValueByName_12, IN[2]=join)
# ---------- compare_all_circs_w_dist_boards.python (34 lines) ----------
import clr
clr.AddReference('ProtoGeometry')
from Autodesk.DesignScript.Geometry import *
clr.AddReference("RevitAPIUI")
from Autodesk.Revit.UI import TaskDialog

#The inputs to this node will be stored as a list in the IN variables.
ElecCircs_Panel = IN[0]
ElecCircs_Load = IN[1]
ElecEquip = IN[2]
ElecCircs_OUT = []
n1 = 0
n2 = 0

msgBox = TaskDialog

while n1 < len(ElecCircs_Load):
	bFoundLoad = False
	bFoundPanel = False
	while n2 < len(ElecEquip):
		if (ElecCircs_Load[n1] == str(ElecEquip[n2])):
			bFoundLoad = True
			#OUT = msgBox.Show("Success", "n1: " + str(n1) + ",n2: " + str(n2) + ",Load: " + ElecCircs_Load[n1] + " ,Equip: " + str(ElecEquip[n2]))
		if (ElecCircs_Panel[n1] == str(ElecEquip[n2])):
			bFoundPanel = True
		if bFoundPanel and bFoundLoad:
			ElecCircs_OUT.append(n1)
			n2 = len(ElecEquip)
		n2 = n2 + 1
	n2 = 0
	n1 = n1 + 1

#Assign your output to the OUT variable.
OUT = ElecCircs_OUT
# ----------------------------------------
getItemAtIndex_4 = List.GetItemAtIndex(list=all_elements_of_category_3, index=compare_all_circs_w_dist_boards)

# group: Cables (Component Type 20)
boards_to_xmfrs = Watch(list_getitematindex_all_xfmr_pri)
string_32 = StringInput("Load Name")
getParameterValueByName_13 = Element.GetParameterValueByName(element=boards_to_xmfrs, parameterName=string_32)
bus_prefix_3 = Watch(bus_prefix)
feeder_post_fix_3 = StringInput("-pri")
pre_post_fix_it = Python(IN[0]=getParameterValueByName_13, IN[1]=bus_prefix_3, IN[2]=feeder_post_fix_3)
# ---------- pre_post_fix_it.python (17 lines) ----------
import clr
clr.AddReference('ProtoGeometry')
from Autodesk.DesignScript.Geometry import *
#The inputs to this node will be stored as a list in the IN variables.
component = IN[0]
prefix = IN[1]
postfix = IN[2]
lcv = 0
list1 = []

while lcv < len(component):
	list1.append(prefix + component[lcv] + postfix)
	lcv = lcv + 1


#Assign your output to the OUT variable.
OUT = list1
# ----------------------------------------
xfmrs_to_boards = Watch(list_getitematindex_xfmr_sec)
string_33 = StringInput("Panel")
getParameterValueByName_14 = Element.GetParameterValueByName(element=xfmrs_to_boards, parameterName=string_33)
feeder_post_fix_4 = StringInput("-sec")
pre_post_fix_it_2 = Python(IN[0]=getParameterValueByName_14, IN[1]=bus_prefix_3, IN[2]=feeder_post_fix_4)  # same code as pre_post_fix_it
string_34 = StringInput("""
// --- Cable ---
//<ComponentName>	<ComponentType>	<ConnectedComponent1>	<ConnectedComponent2>	<QtyPerPhase>	<CableSize>	<Manufacturer>	<CondcutorType>	<DuctMaterial>	<InsulationClass>	<Condcuctor Desc>	<RacewaySize>	<RacewayType>	<KeyInLibrary>	<VoltageRating>	<CircularMils>	<NeutralSize>	<Length>""")  # graph input
board_to_boards = Watch(getItemAtIndex_4)
join_2 = List.Join(list0=board_to_boards, list1=boards_to_xmfrs, list2=xfmrs_to_boards)
watch = Watch(join_2)
string_35 = StringInput("Load Name")
getParameterValueByName_15 = Element.GetParameterValueByName(element=watch, parameterName=string_35)
cable_prefix = Watch(feeder_prefix)
pre_fix_it_4 = Python(IN[0]=getParameterValueByName_15, IN[1]=cable_prefix)  # same code as pre_fix_it
component_name_2 = Watch(pre_fix_it_4)
component_type_cable = StringInput("20")
string_36 = StringInput("Load Name")
getParameterValueByName_16 = Element.GetParameterValueByName(element=board_to_boards, parameterName=string_36)
cb_prefix_2 = Watch(cb_prefix)
feeder_post_fix_5 = StringInput(":2")
pre_post_fix_it_3 = Python(IN[0]=getParameterValueByName_16, IN[1]=cb_prefix_2, IN[2]=feeder_post_fix_5)  # same code as pre_post_fix_it
pre_post_fix_it_4 = Python(IN[0]=getParameterValueByName_13, IN[1]=cb_prefix_2, IN[2]=feeder_post_fix_5)  # same code as pre_post_fix_it
feeder_post_fix_6 = StringInput(":1")
post_fix_it_3 = Python(IN[0]=pre_post_fix_it_2, IN[1]=feeder_post_fix_6)  # same code as post_fix_it
list_join_component1 = List.Join(list0=pre_post_fix_it_3, list1=pre_post_fix_it_4, list2=post_fix_it_3)
connected_component1 = Watch(list_join_component1)
pre_post_fix_it_5 = Python(IN[0]=getParameterValueByName_16, IN[1]=bus_prefix_3, IN[2]=feeder_post_fix_6)  # same code as pre_post_fix_it
post_fix_it_4 = Python(IN[0]=pre_post_fix_it, IN[1]=feeder_post_fix_6)  # same code as post_fix_it
string_37 = StringInput("Load Name")
getParameterValueByName_17 = Element.GetParameterValueByName(element=xfmrs_to_boards, parameterName=string_37)
pre_post_fix_it_6 = Python(IN[0]=getParameterValueByName_17, IN[1]=bus_prefix_3, IN[2]=feeder_post_fix_6)  # same code as pre_post_fix_it
list_join_component2 = List.Join(list0=pre_post_fix_it_5, list1=post_fix_it_4, list2=pre_post_fix_it_6)
connected_componet2 = Watch(list_join_component2)
string_38 = StringInput("# of Runs")
getParameterValueByName_18 = Element.GetParameterValueByName(element=watch, parameterName=string_38)
qty_per_phase = Watch(getParameterValueByName_18)
string_39 = StringInput("Wire Size")
getParameterValueByName_19 = Element.GetParameterValueByName(element=watch, parameterName=string_39)
remove_valus_in_front_of_phase = Python(IN[0]=getParameterValueByName_19)  # "Remove Valus in front of Phase Conductor Script"
# ---------- remove_valus_in_front_of_phase.python (27 lines) ----------
import clr
clr.AddReference('ProtoGeometry')
from Autodesk.DesignScript.Geometry import *
#The inputs to this node will be stored as a list in the IN variables.
wirelist = IN[0]
x = []
list1 = []
max = len(wirelist)
number1 = 0
n = 0
wiremax = 0
wiresep = 0

while n < max:
	wiremax = len(wirelist[n])
	x = wirelist[n]
	if "#" in x:
		wiresep = x.find("#")
		x = x[wiresep+1:]
		list1.append(x)
	else:
		x = x[2:]
		list1.append(x)			
	n = n + 1
		
#Assign your output to the OUT variable.
OUT = list1
# ----------------------------------------
isolate_phase_conductor_script = Python(IN[0]=remove_valus_in_front_of_phase)
# ---------- isolate_phase_conductor_script.python (25 lines) ----------
import clr
clr.AddReference('ProtoGeometry')
from Autodesk.DesignScript.Geometry import *
#The inputs to this node will be stored as a list in the IN variables.
wirelist = IN[0]
x = []
list1 = []
max = len(wirelist)
number1 = 0
n = 0
wiremax = 0
wiresep = 0

while n < max:
	wiremax = len(wirelist[n])
	x = wirelist[n]
	if "," in x:
		wiresep = x.find(",")
		x = x[:wiresep]
		list1.append(x)
	
	n = n + 1
		
#Assign your output to the OUT variable.
OUT = list1
# ----------------------------------------
trade_sizes = Watch(isolate_phase_conductor_script)
string_40 = StringInput("Wire Type")
getParameterValueByName_20 = Element.GetParameterValueByName(element=watch, parameterName=string_40)
string_41 = StringInput("Material")
getParameterValueByName_21 = Element.GetParameterValueByName(element=getParameterValueByName_20, parameterName=string_41)
string_42 = StringInput("Type Name")
getParameterValueByName_22 = Element.GetParameterValueByName(element=getParameterValueByName_21, parameterName=string_42)
watch_2 = Watch(al_name_code_block)
formula = Formula("if(x==y1,true,false)", x=getParameterValueByName_22, y1=watch_2)
MANUFACTURER = StringInput("ALCAN")
MANUFACTURER_2 = StringInput("Typical")
formula_manufacturer = Formula("if(x==true,y1,y2)", x=formula, y1=MANUFACTURER, y2=MANUFACTURER_2)
conductor_type = StringInput("Aluminum")
conductor_type_2 = StringInput("Copper")
formula_conductor_type = Formula("if(x==true,y1,y2)", x=formula, y1=conductor_type, y2=conductor_type_2)
duct_material = StringInput("Magnetic")
insulation_class = StringInput("XHHW-2")
insulation_class_2 = StringInput("THWN")
formula_insulation_class = Formula("if(x==true,y1,y2)", x=formula, y1=insulation_class, y2=insulation_class_2)
conductor_description = StringInput("4C+G")
conductor_description_2 = StringInput("4 Wire+Grnd")
formula_conductor_description = Formula("if(x==true,y1,y2)", x=formula, y1=conductor_description, y2=conductor_description_2)
string_from_object_2 = FromObject(obj=isolate_phase_conductor_script)
find_raceway_script = Python(IN[0]=string_from_object_2)
# ---------- find_raceway_script.python (75 lines) ----------
import clr
clr.AddReference('ProtoGeometry')
from Autodesk.DesignScript.Geometry import *
#The inputs to this node will be stored as a list in the IN variables.
wirelist = IN[0]
x = []
list1 = []
max = len(wirelist)
number1 = 0
n = 0
wiremax = 0


while n < max:
	if "12" in wirelist[n]:
			x = chr(34) + "3/4\"" + chr(34) + chr(34)
			list1.append(x)
	elif "10" in wirelist[n]:
			x = chr(34) + "3/4\"" + chr(34) + chr(34)
			list1.append(x)
	elif "8" in wirelist[n]:
			x = chr(34) + "3/4\"" + chr(34) + chr(34)
			list1.append(x)
	elif "6" in wirelist[n]:
			x = chr(34) + "3/4\"" + chr(34) + chr(34)
			list1.append(x)
	elif "4" in wirelist[n]:
			x = chr(34) + "1\"" + chr(34) + chr(34)
			list1.append(x)
	elif "2" in wirelist[n]:
			x = chr(34) + "1 1/4\"" + chr(34) + chr(34)
			list1.append(x)
	elif "1" in wirelist[n]:
			x = chr(34) + "1 1/4\"" + chr(34) + chr(34)
			list1.append(x)
	elif "1/0" in wirelist[n]:
			x = chr(34) + "1 1/4\"" + chr(34) + chr(34)
			list1.append(x)	
	elif "2/0" in wirelist[n]:
			x = chr(34) + "1 1/2\"" + chr(34) + chr(34)
			list1.append(x)
	elif "3/0" in wirelist[n]:
			x = chr(34) + "2\"" + chr(34) + chr(34)
			list1.append(x)	
	elif "4/0" in wirelist[n]:
			x = chr(34) + "2\"" + chr(34) + chr(34)
			list1.append(x)
	elif "250" in wirelist[n]:
			x = chr(34) + "2\"" + chr(34) + chr(34)
			list1.append(x)
	elif "300" in wirelist[n]:
			x = chr(34) + "2 1/2\"" + chr(34) + chr(34)
			list1.append(x)
	elif "350" in wirelist[n]:
			x = chr(34) + "2 1/2\"" + chr(34) + chr(34)
			list1.append(x)
	elif "400" in wirelist[n]:
			x = chr(34) + "2 1/2\"" + chr(34) + chr(34)
			list1.append(x)	
	elif "500" in wirelist[n]:
			x = chr(34) + "3\"" + chr(34) + chr(34)
			list1.append(x)
	elif "600" in wirelist[n]:
			x = chr(34) + "3-1/2\"" + chr(34) + chr(34)
			list1.append(x)
	elif "750" in wirelist[n]:
			x = chr(34) + "4\"" + chr(34) + chr(34)
			list1.append(x)
	else:
			x = chr(34) + "0000000000" + chr(34) + chr(34)
			list1.append(x)			
	n = n + 1
		
#Assign your output to the OUT variable.
OUT = list1
# ----------------------------------------
raceway = Watch(find_raceway_script)
raceway_type = StringInput("Magnetic")
key_library = StringInput("1")
voltage_rating = StringInput("600")
find_circular_mils_script = Python(IN[0]=isolate_phase_conductor_script)
# ---------- find_circular_mils_script.python (75 lines) ----------
import clr
clr.AddReference('ProtoGeometry')
from Autodesk.DesignScript.Geometry import *
#The inputs to this node will be stored as a list in the IN variables.
wirelist = IN[0]
x = []
list1 = []
max = len(wirelist)
number1 = 0
n = 0
wiremax = 0


while n < max:
	if "12" in wirelist[n]:
			x = "6530"
			list1.append(x)
	elif "10" in wirelist[n]:
			x = "10380"
			list1.append(x)
	elif "8" in wirelist[n]:
			x = "16510"
			list1.append(x)
	elif "6" in wirelist[n]:
			x = "26240"
			list1.append(x)
	elif "4/0" in wirelist[n]:
			x = "211600"
			list1.append(x)
	elif "4" in wirelist[n]:
			x = "41740"
			list1.append(x)
	elif "2/0" in wirelist[n]:
			x = "133100"
			list1.append(x)
	elif "2" in wirelist[n]:
			x = "66360"
			list1.append(x)
	elif "1/0" in wirelist[n]:
			x = "105600"
			list1.append(x)
	elif "1" in wirelist[n]:
			x = "83690"
			list1.append(x)
	elif "3/0" in wirelist[n]:
			x = "167800"
			list1.append(x)
	elif "250" in wirelist[n]:
			x = "250000"
			list1.append(x)
	elif "300" in wirelist[n]:
			x = "300000"
			list1.append(x)
	elif "350" in wirelist[n]:
			x = "350000"
			list1.append(x)
	elif "400" in wirelist[n]:
			x = "400000"
			list1.append(x)
	elif "500" in wirelist[n]:
			x = "500000"
			list1.append(x)
	elif "600" in wirelist[n]:
			x = "600000"
			list1.append(x)
	elif "750" in wirelist[n]:
			x = "750000"
			list1.append(x)
	else:
			x = "0000000000"
			list1.append(x)			
	n = n + 1
		
#Assign your output to the OUT variable.
OUT = list1
# ----------------------------------------
circular_mils = Watch(find_circular_mils_script)
string_43 = StringInput("Length")
getParameterValueByName_23 = Element.GetParameterValueByName(element=watch, parameterName=string_43)
number = DoubleInput(0)  # graph input
round = Math.Round(number=getParameterValueByName_23, digits=number)
n1_to_length_if_0_script = Python(IN[0]=round)  # "1 to length if 0 Script"
# ---------- n1_to_length_if_0_script.python (24 lines) ----------
import clr
clr.AddReference('ProtoGeometry')
from Autodesk.DesignScript.Geometry import *
#The inputs to this node will be stored as a list in the IN variables.
wirelist = IN[0]
x = []
list1 = []
max = len(wirelist)
number1 = 0
n = 0
wiremax = 0
removestringlen = 0
loc1 = 0
while n < max:
	if "0" == wirelist[n]:
		x = "1"
		list1.append(x)
	else:
		x = str(wirelist[n])
		list1.append(x)
	n = n + 1
		
#Assign your output to the OUT variable.
OUT = list1
# ----------------------------------------
length = Watch(n1_to_length_if_0_script)
create_skm_wire_output_string = Python(IN[0]=delimiter_tab, IN[1]=component_name_2, IN[2]=component_type_cable, IN[3]=connected_component1, IN[4]=connected_componet2, IN[5]=qty_per_phase, IN[6]=trade_sizes, IN[7]=formula_manufacturer, IN[8]=formula_conductor_type, IN[9]=duct_material, IN[10]=formula_insulation_class, IN[11]=formula_conductor_description, IN[12]=raceway, IN[13]=raceway_type, IN[14]=key_library, IN[15]=voltage_rating, IN[16]=circular_mils, IN[17]=trade_sizes, IN[18]=length)
# ---------- create_skm_wire_output_string.python (37 lines) ----------
import clr
clr.AddReference('ProtoGeometry')
from Autodesk.DesignScript.Geometry import *
#The inputs to this node will be stored as a list in the IN variables.
sep = ","
DeLim = IN[0]
wirename = IN[1]
ComponentType = IN[2]
ComponentName1 = IN[3]
ComponentName2 = IN[4]
QtyPerPhase = IN[5]
CableSize = IN[6]
Manufacturer = IN[7]
ConductorType = IN[8]
DuctMaterial = IN[9]
InsulationType = IN[10]
ConductorDesc = IN[11]
RacewaySize =IN[12]
RacewayType = IN[13]
KeyInLibrary = IN[14]
VoltageRating = IN[15]
CircularMils = IN[16]
NeutralSize = IN[17]
Length = IN[18]

x = []
list1 = []
max = len(wirename)
n = 0

while n < max:
	list1.append(wirename[n] + DeLim + ComponentType + DeLim + ComponentName1[n] + DeLim + ComponentName2[n] + DeLim + str(QtyPerPhase[n]) + DeLim + CableSize[n] + DeLim + Manufacturer[n] + DeLim + ConductorType[n] + DeLim + DuctMaterial + DeLim + InsulationType[n] + DeLim + ConductorDesc[n] + DeLim + RacewaySize[n] + DeLim + RacewayType + DeLim + KeyInLibrary + DeLim + VoltageRating + DeLim + CircularMils[n] + DeLim + NeutralSize[n] + DeLim + Length[n])
	
	n = n + 1
		
#Assign your output to the OUT variable.
OUT = list1
# ----------------------------------------
skm_output_wire_string = Watch(create_skm_wire_output_string)
join_3 = List.Join(list0=string_34, list1=skm_output_wire_string)
string_44 = StringInput("Wire Type")
getParameterValueByName_24 = Element.GetParameterValueByName(element=watch, parameterName=string_44)
string_45 = StringInput("Insulation")
getParameterValueByName_25 = Element.GetParameterValueByName(element=getParameterValueByName_24, parameterName=string_45)
string_46 = StringInput("Type Name")
getParameterValueByName_26 = Element.GetParameterValueByName(element=getParameterValueByName_25, parameterName=string_46)
insulation_class_3 = Watch(getParameterValueByName_26)

# group: Buses (Component Type 10)
string_47 = StringInput("""
// --- Bus ---
//<ComponentName>	<ComponentType>	<SystemNominalVoltage>	<NodeBus>""")  # graph input
watch_3 = Watch(delimiter_tab)
all_swbd_and_panels_elec_eq = Watch(join)
string_48 = StringInput("Number of Phases")
getParameterValueByName_27 = Element.GetParameterValueByName(element=all_swbd_and_panels_elec_eq, parameterName=string_48)
formula_2 = Formula("if(x==3,true,false)", x=getParameterValueByName_27)
string_49 = StringInput("Distribution System")
getParameterValueByName_28 = Element.GetParameterValueByName(element=all_swbd_and_panels_elec_eq, parameterName=string_49)
string_from_object_3 = FromObject(obj=getParameterValueByName_28)
code_block = CodeBlock { ""; }
formula_3 = Formula("if(x==empty,false,true)", x=string_from_object_3, empty=code_block)
and_ = formula_2 && formula_3
filterByBoolMask = List.FilterByBoolMask(list=all_swbd_and_panels_elec_eq, mask=and_)
string_50 = StringInput("Panel Name")
getParameterValueByName_29 = Element.GetParameterValueByName(element=filterByBoolMask.in, parameterName=string_50)
pre_fix_it_5 = Python(IN[0]=getParameterValueByName_29, IN[1]=bus_prefix)  # same code as pre_fix_it
component_type_2 = StringInput("10")
string_51 = StringInput("Distribution System")
getParameterValueByName_30 = Element.GetParameterValueByName(element=filterByBoolMask.in, parameterName=string_51)
string_52 = StringInput("Line to Line Voltage")
getParameterValueByName_31 = Element.GetParameterValueByName(element=getParameterValueByName_30, parameterName=string_52)
string_53 = StringInput("Actual Voltage")
getParameterValueByName_32 = Element.GetParameterValueByName(element=getParameterValueByName_31, parameterName=string_53)
node_bus = StringInput("0")  # graph input
create_skm_bus_string = Python(IN[0]=watch_3, IN[1]=pre_fix_it_5, IN[2]=component_type_2, IN[3]=getParameterValueByName_32, IN[4]=node_bus)
# ---------- create_skm_bus_string.python (22 lines) ----------
import clr
clr.AddReference('ProtoGeometry')
from Autodesk.DesignScript.Geometry import *
#The inputs to this node will be stored as a list in the IN variables.
sep = ","
#ComponentPrefix = IN[4]
DeLim = IN[0]
ComponentName = IN[1]
ComponentType = IN[2]
Systemvoltage = IN[3]
NodeBus = IN[4]

list1 = []
n = 0

while n < len(ComponentName):
	list1.append(ComponentName[n] + DeLim + ComponentType + DeLim + str(Systemvoltage[n]) + DeLim + NodeBus)

	n = n + 1
		
#Assign your output to the OUT variable.
OUT = list1
# ----------------------------------------
list_join_node_buses = List.Join(list0=pre_post_fix_it, list1=pre_post_fix_it_2)
component_type_3 = StringInput("10")
list_join_node_bus_volts = List.Join(list0=boards_to_xmfrs, list1=xfmrs_to_boards)
string_54 = StringInput("Voltage")
getParameterValueByName_33 = Element.GetParameterValueByName(element=list_join_node_bus_volts, parameterName=string_54)
node_bus_2 = StringInput("1")  # graph input
create_skm_bus_string_2 = Python(IN[0]=watch_3, IN[1]=list_join_node_buses, IN[2]=component_type_3, IN[3]=getParameterValueByName_33, IN[4]=node_bus_2)
# ---------- create_skm_bus_string_2.python (22 lines) ----------
import clr
clr.AddReference('ProtoGeometry')
from Autodesk.DesignScript.Geometry import *
#The inputs to this node will be stored as a list in the IN variables.
sep = ","
#ComponentPrefix = IN[4]
DeLim = IN[0]
ComponentName = IN[1]
ComponentType = IN[2]
Systemvoltage = IN[3]
NodeBus = IN[4]

list1 = []
n = 0

while n < len(ComponentName):
	list1.append(ComponentName[n] + DeLim + ComponentType + DeLim + str(Systemvoltage[n]) + DeLim + NodeBus)
	
	n = n + 1
		
#Assign your output to the OUT variable.
OUT = list1
# ----------------------------------------
join_4 = List.Join(list0=create_skm_bus_string, list1=create_skm_bus_string_2)
join_5 = List.Join(list0=string_47, list1=join_4)
python_script_convert_volts_3 = Python(IN[0]=getParameterValueByName_33)  # same code as python_script_convert_volts
python_script_convert_volts_4 = Python(IN[0]=getParameterValueByName_32)  # same code as python_script_convert_volts

string_from_object_4 = FromObject(obj=getParameterValueByName_7)

# group (continued): Transformers (Component Type 30)
primary_voltage = Watch(string_from_object_4)

string_from_object_5 = FromObject(obj=getParameterValueByName_10)

# group (continued): Transformers (Component Type 30)
secondary_voltage = Watch(string_from_object_5)
create_skm_xfmr_output_string = Python(IN[0]=delimiter_tab, IN[1]=component_name, IN[2]=component_type, IN[3]=upstream_component_1, IN[4]=downstream_component_2, IN[5]=nominal_kva, IN[6]=primary_voltage, IN[7]=secondary_voltage, IN[8]=type, IN[9]=key_in_library)
# ---------- create_skm_xfmr_output_string.python (26 lines) ----------
import clr
clr.AddReference('ProtoGeometry')
from Autodesk.DesignScript.Geometry import *
#The inputs to this node will be stored as a list in the IN variables.
sep = ","
DeLim = IN[0]
Componentname = IN[1]
ComponentType = IN[2]
ComponentName1 = IN[3]
ComponentName2 = IN[4]
NominalKVA= IN[5]
PriRatedVoltage = IN[6]
SecRatedVoltage = IN[7]
Type = IN[8]
KeyInLibrary = IN[9]
list1 = []
max = len(Componentname)
n = 0

while n < max:
	list1.append(Componentname[n] + DeLim + ComponentType + DeLim + ComponentName1[n] + DeLim + ComponentName2[n] + DeLim + NominalKVA[n] + DeLim + PriRatedVoltage[n] + DeLim + SecRatedVoltage[n] + DeLim + Type + DeLim + KeyInLibrary)
	
	n = n + 1
		
#Assign your output to the OUT variable.
OUT = list1
# ----------------------------------------
join_6 = List.Join(list0=string_7, list1=create_skm_xfmr_output_string)

bus_prefix_4 = Watch(bus_prefix)

# group: Circuit Breakers (Component type 112)
string_55 = StringInput("""
// --- Protective Device ---
//<ComponentName>	<ComponentType>	<ConnectedComponent1>	<ConnectedComponent2>""")  # graph input
join_7 = List.Join(list0=board_to_boards, list1=boards_to_xmfrs)
string_56 = StringInput("Load Name")
getParameterValueByName_34 = Element.GetParameterValueByName(element=join_7, parameterName=string_56)
cb_prefix_3 = Watch(cb_prefix)
pre_fix_it_6 = Python(IN[0]=getParameterValueByName_34, IN[1]=cb_prefix_3)  # same code as pre_fix_it
component_name_3 = Watch(pre_fix_it_6)
component_type_cable_2 = StringInput("112")
string_57 = StringInput("Panel")
getParameterValueByName_35 = Element.GetParameterValueByName(element=join_7, parameterName=string_57)
feeder_post_fix_7 = StringInput(":1")
pre_post_fix_it_7 = Python(IN[0]=getParameterValueByName_35, IN[1]=bus_prefix_4, IN[2]=feeder_post_fix_7)  # same code as pre_post_fix_it
string_58 = StringInput("Load Name")
getParameterValueByName_36 = Element.GetParameterValueByName(element=join_7, parameterName=string_58)
cable_prefix_2 = Watch(feeder_prefix)
pre_post_fix_it_8 = Python(IN[0]=getParameterValueByName_36, IN[1]=cable_prefix_2, IN[2]=feeder_post_fix_7)  # same code as pre_post_fix_it

upstream_component_1_2 = Watch(pre_post_fix_it_7)
upstream_component_2 = Watch(pre_post_fix_it_8)

# group (continued): Circuit Breakers (Component type 112)
create_skm_wire_output_string_2 = Python(IN[0]=delimiter_tab, IN[1]=component_name_3, IN[2]=component_type_cable_2, IN[3]=upstream_component_1_2, IN[4]=upstream_component_2)
# ---------- create_skm_wire_output_string_2.python (23 lines) ----------
import clr
clr.AddReference('ProtoGeometry')
from Autodesk.DesignScript.Geometry import *
#The inputs to this node will be stored as a list in the IN variables.
sep = ","
DeLim = IN[0]
wirename = IN[1]
ComponentType = IN[2]
ComponentName1 = IN[3]
ComponentName2 = IN[4]

x = []
list1 = []
max = len(wirename)
n = 0

while n < max:
	list1.append(wirename[n] + DeLim + ComponentType + DeLim + ComponentName1[n] + DeLim + ComponentName2[n])
	
	n = n + 1
		
#Assign your output to the OUT variable.
OUT = list1
# ----------------------------------------
skm_output_wire_string_2 = Watch(create_skm_wire_output_string_2)
join_8 = List.Join(list0=string_55, list1=skm_output_wire_string_2)

# group: Writes to selected file
string_59 = StringInput(".rpt")
concat = String.Concat(string0=file_path, string1=string_59)
carage_return = StringInput("\n")  # graph input
join_9 = String.Join(separator=carage_return, string0=join_5, string1=join_3, string2=join_6, string3=join_8)
exportCSV = Data.ExportCSV(filePath=concat, data=join_9)

string_60 = StringInput("""WSP
Revit to SKM data parser.
By: Scott Stannard, Trey Ruiz
Date: 02/20/18
Output to the CCRD-IO skm datablock format.

Currently Supports:
Feeders,
Bus,
XFMR,

To Do:
ATS,
Motors""")  # graph input

# group: All Equipment Switches (ATS?)
string_61 = StringInput("Part Type : Equipment Switch")  # graph input
reduces_list_to_a_list_of_only_4 = Python(IN[0]=string_from_object, IN[1]=string_61)  # "Reduces list to a list of only IN[1]"; same code as reduces_list_to_a_list_of_only
getItemAtIndex_5 = List.GetItemAtIndex(list=all_elements_of_category, index=reduces_list_to_a_list_of_only_4)

join_10 = List.Join(list0=getItemAtIndex, list1=getItemAtIndex_2, list2=getItemAtIndex_3)
code_block_2 = CodeBlock()
# ---------- code_block_2.designscript (4 lines) ----------
def MyVariable (x)
{
	return = "Happy Return";
};
# ----------------------------------------
code_block_3 = CodeBlock { MyVariable(1); }
